# Grasshopper definition bridges.gh (Grasshopper 1.0.7)
# plug-ins: HAL for Grasshopper, Kangaroo Components, Weaverbird, Kangaroo2 Components

sessionsettings = SessionSettings()
crv = Curve(<curve referenced from the Rhino model>)
mplane = MeshPlane(Boundary=crv, WidthCount=Slider(14, range=5..30), HeightCount=Slider(60, range=0..60))  # -> Mesh, Area
crv_2 = Curve(<curve referenced from the Rhino model>)
crv_3 = Curve(<curve referenced from the Rhino model>)
srf = Surface(crv_3)
conmesh = ConstructMesh(Vertices=[Point(0, 0, 0), Point(10, 0, 0), Point(10, 10, 0), Point(0, 10, 0)], Faces={A=0, B=1, C=2, D=3})
wbedges = WeaverbirdsMeshEdges(MeshOrPolylines=mplane.Mesh)
meshcorners = MeshCorners(M=mplane.Mesh, A=0.5235987756)
mplane_2 = MeshPlane(Boundary=crv_3, WidthCount=Slider(5, range=0..30), HeightCount=Slider(9, range=0..60))  # -> Mesh, Area
wbedges_2 = WeaverbirdsMeshEdges(MeshOrPolylines=mplane_2.Mesh)
demesh = DeconstructMesh(Mesh=mplane.Mesh)  # -> Vertices, Faces, Colours, Normals
c_script = CSharpScript(p=demesh.Vertices)  # -> out, C, B; inputs p: list of Point3d
# ---------- c_script: C# ----------
    List<Point3d> c = new List<Point3d>();
    List<Point3d> b = new List<Point3d>();

    for (int i = 0; i < p.Count; i++){

      if(i % 42 == 0){
        b.Add(p[i]);

      }
    }
    for (int i = 1; i < p.Count; i++){

      if(i % 42 == 0){
        c.Add(p[i - 1]);
      }
    }


    C = c;

    B = b;
# ---------- end c_script ----------
pt = Point(c_script.B)
pt_2 = Point(c_script.C)
meshcorners_2 = MeshCorners(M=mplane_2.Mesh, A=0.5235987756)
Z = UnitZ(Factor=Slider(40.958, range=-10..200))
pt_3 = Point([pt, pt_2])
mesh_uv = MeshSurface(UCount=5, VCount=5, Overhang=True, Equalize=False)
len = Length(Curve=wbedges)
multiplication = Multiplication(A=len, B=Slider(1, range=0..1))
show = Show(G=mplane.Mesh)
anchor = Anchor(Point=pt_3, Strength=10000)
load = Load(Point=demesh.Vertices, ForceVector=Z, Weighting=1)
demesh_2 = DeconstructMesh(Mesh=mplane_2.Mesh)  # -> Vertices, Faces, Colours, Normals
length_line = LengthLine(Line=wbedges, Length=multiplication, Strength=10)
Z_2 = UnitZ(Factor=Slider(8.802, range=-100..200))
len_2 = Length(Curve=wbedges_2)
anchor_2 = Anchor(Point=meshcorners_2, Strength=10000)
brep = Brep(<brep referenced from the Rhino model>)  # disabled
brep_2 = Brep(<brep referenced from the Rhino model>)
multiplication_2 = Multiplication(A=len_2, B=Slider(1, range=0..1))
show_2 = Show(G=mplane_2.Mesh)
length_line_2 = LengthLine(Line=wbedges_2, Length=multiplication_2, Strength=10)
load_2 = Load(Point=demesh_2.Vertices, ForceVector=Z_2, Weighting=1)
mesh = Mesh(brep)  # disabled
mesh_2 = Mesh(brep_2)
merge = Merge(Data1=length_line, Data2=anchor, Data3=load, Data4=show)
toggle = BooleanToggle(False)
diag = Diagonalize(Mesh=mesh)  # disabled
mesh_3 = Mesh(<mesh referenced from the Rhino model>)  # disabled
diag_2 = Diagonalize(Mesh=mesh_2)
mesh_4 = Mesh(<mesh referenced from the Rhino model>)
diag_3 = Diagonalize(Mesh=diag)  # disabled
diag_4 = Diagonalize(Mesh=diag_2)
diag_5 = Diagonalize(Mesh=mesh_3)  # disabled
diag_6 = Diagonalize(Mesh=mesh_4)
merge_2 = Merge(Data1=graft(length_line_2), Data2=graft(anchor_2), Data3=graft(load_2), Data4=show_2)
Z_3 = UnitZ(Factor=1)
bouncysolver = BouncySolver(
    GoalObjects=merge,
    Reset=toggle,
    Threshold=1e-15,
    Tolerance=0.01,
    Damping=0.99,
    Iterations=Slider(24, range=-1..30),
    On=toggle)  # -> I, V, O
solver = Solver(GoalObjects=merge, Reset=toggle, Threshold=1e-15, Tolerance=0.01, On=True)  # -> I, V, O
wbfacepolys = WeaverbirdsFacePolylines(Mesh=diag_3)  # disabled
wbfacepolys_2 = WeaverbirdsFacePolylines(Mesh=diag_4)
multiplication_3 = Multiplication(A=Z_3, B=Slider(388, range=-1000..1000))
move = Move(Geometry=demesh_2.Vertices, Motion=multiplication_3)  # -> Geometry, Transform
solver_2 = Solver(GoalObjects=merge_2, Reset=Toggle(False), Threshold=1e-15, Tolerance=0.01, On=True)  # -> I, V, O
number_slider = Slider(0.8, range=0..1)  # disabled
explode = Explode(Curve=wbfacepolys, Recursive=True)  # -> Segments, Vertices; disabled
avr = Average(Input=explode.Vertices)  # disabled
panel = Panel(explode.Segments)  # disabled
explode_2 = Explode(Curve=wbfacepolys_2, Recursive=True)  # -> Segments, Vertices
avr_2 = Average(Input=explode_2.Vertices)
panel_2 = Panel(explode_2.Segments)
scale = Scale(Geometry=explode.Segments, Center=avr, Factor=number_slider)  # -> Geometry, Transform; disabled
panel_3 = Panel(scale.Geometry)  # disabled
scale_2 = Scale(Geometry=explode_2.Segments, Center=avr_2, Factor=Slider(0.8, range=0..1))  # -> Geometry, Transform
panel_4 = Panel(scale_2.Geometry)
move_2 = Move(Geometry=srf, Motion=multiplication_3)  # -> Geometry, Transform
ln = Line(StartPoint=move.Geometry, EndPoint=solver_2.V)
bang = ExplodeTree(Data=solver_2.O)  # -> Branch0, Branch1
merge_3 = Merge(Data1=graft(explode.Segments), Data2=graft(scale.Geometry))  # disabled
preview = CustomPreview(
    Geometry=solver_2.O,
    Material={diffuse=RGB(221, 160, 221), emission=RGB(66, 48, 66), shine=0.5, specular=RGB(255, 255, 255), transparency=0})
merge_4 = Merge(Data1=graft(explode_2.Segments), Data2=graft(scale_2.Geometry))
panel_5 = Panel(bang.Branch1)
panel_6 = Panel(bang.Branch0)
number_slider_2 = Slider(2, range=0..10)  # disabled
partition = PartitionList(List=merge_3, Size=number_slider_2)  # disabled
panel_7 = Panel(partition)  # disabled
partition_2 = PartitionList(List=merge_4, Size=Slider(2, range=0..10))
panel_8 = Panel(partition_2)
mesh_5 = Mesh(bang.Branch0)
loft = Loft(Curves=partition, Options={Adjust=False, Closed=False, LoftEnds=0, LoftSimp=0, LoftType=0, Rebuild=10, Refit=0.01})  # disabled
loft_2 = Loft(Curves=partition_2, Options={Adjust=False, Closed=False, LoftEnds=0, LoftSimp=0, LoftType=0, Rebuild=10, Refit=0.01})
diag_7 = Diagonalize(Mesh=mesh_5)
mesh_uv_2 = MeshSurface(Surface=loft, UCount=5, VCount=5, Overhang=True, Equalize=False)  # disabled
mesh_uv_3 = MeshSurface(Surface=loft_2, UCount=5, VCount=5, Overhang=True, Equalize=False)
wbfacepolys_3 = WeaverbirdsFacePolylines(Mesh=diag_7)
wbjoin = WeaverbirdsJoinMeshesAndWeld(Mesh=flatten(mesh_uv_2), Weld=False)  # disabled
wbjoin_2 = WeaverbirdsJoinMeshesAndWeld(Mesh=flatten(mesh_uv_3), Weld=False)
wbthicken = WeaverbirdsMeshThicken(MeshCurves=wbjoin, Distance=5, OffsetType=0)  # disabled
wbthicken_2 = WeaverbirdsMeshThicken(MeshCurves=wbjoin_2, Distance=5, OffsetType=0)
explode_3 = Explode(Curve=wbfacepolys_3, Recursive=True)  # -> Segments, Vertices
avr_3 = Average(Input=explode_3.Vertices)
panel_9 = Panel(explode_3.Segments)
scale_3 = Scale(Geometry=explode_3.Segments, Center=avr_3, Factor=Slider(0.8, range=0..1))  # -> Geometry, Transform
panel_10 = Panel(scale_3.Geometry)
number_slider_3 = Slider(1.8, range=0..10)  # disabled
wbcatmullclark = WeaverbirdsCatmullClarkSubdivision(MeshCurves=wbthicken, Level=number_slider_3, SmoothNakedEdges=1)  # disabled
wbcatmullclark_2 = WeaverbirdsCatmullClarkSubdivision(MeshCurves=wbthicken_2, Level=Slider(1.8, range=0..10), SmoothNakedEdges=1)
merge_5 = Merge(Data1=graft(explode_3.Segments), Data2=graft(scale_3.Geometry))
partition_3 = PartitionList(List=merge_5, Size=Slider(2, range=0..10))
panel_11 = Panel(partition_3)
loft_3 = Loft(Curves=partition_3, Options={Adjust=False, Closed=False, LoftEnds=0, LoftSimp=0, LoftType=0, Rebuild=10, Refit=0.01})
mesh_uv_4 = MeshSurface(Surface=loft_3, UCount=5, VCount=5, Overhang=True, Equalize=False)
wbjoin_3 = WeaverbirdsJoinMeshesAndWeld(Mesh=flatten(mesh_uv_4), Weld=False)
wbthicken_3 = WeaverbirdsMeshThicken(MeshCurves=wbjoin_3, Distance=5, OffsetType=0)
wbcatmullclark_3 = WeaverbirdsCatmullClarkSubdivision(MeshCurves=wbthicken_3, Level=Slider(1.8, range=0..10), SmoothNakedEdges=1)

# ==== cluster MeshCorners: Finds the corners of the boundary of a mesh
M = ClusterInput()
medges = MeshEdges(Mesh=M)  # -> NakedEdges, InteriorEdges, NonManifoldEdges
join = JoinCurves(Curves=medges.NakedEdges, Preserve=False)
explode = Explode(Curve=join, Recursive=True)  # -> simplify(Segments), Vertices
shift = ShiftList(List=explode.Segments, Shift=1, Wrap=True)  # -> simplify(List)
end = EndPoints(Curve=explode.Segments)  # -> Start, End
angle = Angle(VectorA=explode.Segments, VectorB=shift)  # -> Angle, Reflex
A = ClusterInput()
smaller = SmallerThan(FirstNumber=A, SecondNumber=angle.Angle)  # -> SmallerThan, OrEqualTo
cull = CullPattern(List=end.End, CullPattern=smaller.SmallerThan)  # -> flatten(List)
L = ClusterOutput(cull)
