# Grasshopper definition Sweep_Railing_Columns.gh (Grasshopper 1.0.7)
# plug-ins: Pufferfish, HAL for Grasshopper

crv = Curve(<curve referenced from the Rhino model>)
Z = UnitZ(Factor=graft("100"))
panel = Panel("""200
400
600
800
1000
1200
1400
1600
1800
2000
2200""")
srf = Surface(crv)
Z_2 = UnitZ(Factor=graft("1000"))
extr = Extrude(Base=srf, Direction=Z)
# railing
sessionsettings = SessionSettings()
move = Move(Geometry=crv, Motion=Z)  # -> Geometry, Transform
extr_2 = Extrude(Base=move.Geometry, Direction=Z_2)
crv_2 = Curve(graft(<curve referenced from the Rhino model>))
offcrv = OffsetCurve(Curve=move.Geometry, Distance="-30", Plane=PlaneXY(0, 0, 0), BothSides=False, Kinks=0, CapType=1)
Z_3 = UnitZ(Factor=graft("1000"))
crv_3 = Curve([<curve referenced from the Rhino model> x205])  # disabled
end = EndPoints(Curve=crv_2)  # -> Start, End
len = Length(Curve=offcrv)
divide = DivideCurve(Curve=crv_2, Count=10, Kinks=False)  # -> Points, Tangents, Parameters
move_2 = Move(Geometry=offcrv, Motion=Z_3)  # -> Geometry, Transform
end_2 = EndPoints(Curve=offcrv)  # -> Start, End
panel_2 = Panel("0.0005")  # disabled
len_2 = Length(Curve=crv_3)  # disabled
division = Division(A=len, B="800")
divide_2 = DivideCurve(Curve=offcrv, Count=division, Kinks=False)  # -> Points, Tangents, Parameters
crv_4 = Curve(move_2.Geometry)
end_3 = EndPoints(Curve=move_2.Geometry)  # -> Start, End
srf_2 = Surface(<surface referenced from the Rhino model>)  # disabled
item = ListItem(List=divide.Points, Index="-1", Wrap=True)
item_2 = ListItem(List=divide.Points, Index="-2", Wrap=True)
srf_3 = Surface(crv_4)
multiplication = Multiplication(A=len_2, B=panel_2)  # disabled
pln = Plane(move_2.Geometry)
project = Project(Geometry=divide_2.Points, Plane=pln)  # -> Geometry, Transform
pln_2 = Plane(srf_2)  # disabled
project_2 = ProjectPoint(Point=divide_2.Points, Direction=Vector(0, 0, -1), Geometry=srf_3)  # -> Point, Index
ln = Line(StartPoint=divide_2.Points, EndPoint=project.Geometry)  # -> flatten(Line)
ln_2 = Line(StartPoint=end_3.Start, EndPoint=end_2.Start)
vec2pt = Vector2Pt(PointA=divide_2.Points, PointB=project.Geometry, Unitize=False)  # -> Vector, Length
divlength = DivideLength(Curve=ln_2, Length="200")  # -> Points, Tangents, Parameters
divide_3 = DivideCurve(Curve=crv_3, Count=multiplication, Kinks=False)  # -> Points, Tangents, Parameters; disabled
project_3 = Project(Geometry=divide_3.Points, Plane=pln_2)  # -> Geometry, Transform; disabled
vec2pt_2 = Vector2Pt(PointA=item_2, PointB=item, Unitize=False)  # -> Vector, Length
circle = CircleCNR(Center=item, Normal=vec2pt_2.Vector, Radius="1.5")
offset = OffsetCurve(Curve=offcrv, Distance="15", Plane=PlaneXY(0, 0, 0), Corners=1)
len_3 = Length(Curve=ln_2)
ln_3 = Line(StartPoint=divide_3.Points, EndPoint=project_3.Geometry)  # -> flatten(Line); disabled
vec2pt_3 = Vector2Pt(PointA=divide_3.Points, PointB=project_3.Geometry, Unitize=False)  # -> Vector, Length; disabled
multiplication_2 = Multiplication(A=len_3, B=divlength.Parameters)
# columns along railing
swp1 = Sweep1(Rail=crv_2, Sections=circle, Miter=1)
extr_3 = Extrude(Base=offset, Direction=Z_3)
Z_4 = UnitZ(Factor=multiplication_2)
panel_3 = Panel("1.5")  # disabled
circle_2 = CircleCNR(Center=divide_3.Points, Normal=vec2pt_3.Vector, Radius=panel_3)  # disabled
move_3 = Move(Geometry=offcrv, Motion=Z_4)  # -> Geometry, Transform
crv_5 = Curve(move_3.Geometry)
extr_4 = Extrude(Base=circle_2, Direction=ln_3)  # disabled
circle_3 = CircleCNR(Center=divide_2.Points, Normal=vec2pt.Vector, Radius="10")
Z_5 = UnitZ(Factor=graft("10"))
extr_5 = Extrude(Base=crv_5, Direction=Z_5)
cap = CapHoles(Brep=extr_3)
cap_2 = CapHoles(Brep=extr_2)
cap_3 = CapHoles(Brep=extr)
extr_6 = Extrude(Base=circle_3, Direction=vec2pt.Vector)
