# Grasshopper definition escalator.gh (Grasshopper 1.0.7)

level_difference = Slider(755, range=300..1500, expression="0.01*x")
slope_angle = Slider(7, range=3..7, expression="5.0*x")
orientation_angle = Slider(360, range=0..360)
supposed_riser_value_ceiling_rounded = Slider(0.2, range=0.18..0.22)
stair_width = Slider(20, range=18..36, expression="0.05*x")
stair_depth = Slider(24, range=18..24, expression="0.05*x")
upper_lower_landing_extend = Slider(30, range=18..30, expression="0.05*x")
upper_lower_room_extend = Slider(58, range=36..72, expression="0.05*x")
deck_height = Slider(5, range=5..12, expression="0.05*x")
deck_width = Slider(6, range=6..12, expression="0.05*x")
deck_extend = Slider(11, range=6..12, expression="0.05*x")
handrail_height = Slider(20, range=18..24, expression="0.05*x")
deck_profile_fillet_radius = Slider(36, range=18..36, expression="0.05*x")
level_difference_2 = Slider(2250, range=300..3000, expression="0.01*x")
construct_point = ConstructPoint(XCoordinate=Slider(0, range=0..100), YCoordinate=Slider(0, range=0..100), ZCoordinate=Slider(0, range=0..100))
escalator = Escalator(
    seed_point=construct_point,
    level_difference=level_difference_2,
    slope_angle=slope_angle,
    orientation_angle=orientation_angle,
    riser_value=supposed_riser_value_ceiling_rounded,
    stair_width=stair_width,
    stair_depth=stair_depth,
    landing_extend=upper_lower_landing_extend,
    room_extend=upper_lower_room_extend,
    deck_height=deck_height,
    deck_width=deck_width,
    deck_extend=deck_extend,
    handrail_height=handrail_height,
    profile_fillet=deck_profile_fillet_radius)  # -> escalator_2, riser_value_2

# ==== cluster Escalator
orientation_angle = ClusterInput()  # Angle to orient the Escalator (Horizontal Angle)
level_difference = ClusterInput()  # Height to travel /recommended from 3 to 15/
slope_angle = ClusterInput()  # Angle to travel at (Vertical angle) /recommended from 15 to 35/
seed_point = ClusterInput()  # First riser position locator
riser_value = ClusterInput()  # Supposed Riser Value (Ceiling Rounded) /recommended from 0.18 to 0.22/
stair_width = ClusterInput()  # Moving steps width (not overall width) /recommended from 0.9 to 1.8/
landing_extend = ClusterInput()  # Upper/Lower landing extend /recommended from 0.9 to 1.5/
stair_depth = ClusterInput()  # Height (Inclined not Vertical) of area beneath steps /recommended from 0.9 to 1.2/
deck_width = ClusterInput()  # By side decks width /recommended from 0.3 to 0.6/
room_extend = ClusterInput()  # Upper/Lower room extend /recommended from 1.8 to 3.6/
deck_height = ClusterInput()  # By side decks height /recommended from 0.25 to 0.6/
deck_extend = ClusterInput()  # By side decks extend after steping ends /recommended from 0.3 to 0.6/
profile_fillet = ClusterInput()  # Radius to adjust elements profiles fillets/recommended from 0.9 to 1.8/
handrail_height = ClusterInput()  # Sum of glass baluster height and deck height /recommended from 0.9 to 1.2/

# ---- group: Stepping Slope Line
supposed_riser_value_ceiling_rounded = Number(riser_value)
_1 = Integer(1)
_1_2 = Integer(1)
unit_z = UnitZ(Factor=1)

# ---- group: Create Slope Line
seed_point_2 = Point(seed_point)
level_difference_2 = Number(level_difference)
slope_line_start_point = Point(seed_point_2)
slope_angle_2 = Number(slope_angle)
radians = Radians(Degrees=slope_angle_2)
right_trigonometry = RightTrigonometry(Alpha=radians, QLength=level_difference_2)  # -> Alpha, Beta, PLength, QLength, RLength

# ---- group: Create Host (Vertical) Plane
orientation_angle_2 = Number(orientation_angle)
radians_2 = Radians(Degrees=orientation_angle_2)
unit_x = UnitX(Factor=1)
unit_z_2 = UnitZ(Factor=1)
rotate = Rotate(Vector=unit_x, Axis=unit_z_2, Angle=radians_2)
construct_plane = ConstructPlane(Origin=slope_line_start_point, XAxis=rotate, YAxis=unit_z_2)
host_vertical_plane = Plane(construct_plane)
deconstruct_plane = DeconstructPlane(Plane=host_vertical_plane)  # -> Origin, XAxis, YAxis, ZAxis

# ---- group: Create Slope Line (continued)
point_oriented = PointOriented(BasePlane=host_vertical_plane, UComponent=right_trigonometry.PLength, VComponent=level_difference_2, WComponent=0)
slope_line_end_point = Point(point_oriented)
line = Line(StartPoint=slope_line_start_point, EndPoint=slope_line_end_point)
slope_line = Line(line)

# ---- group: Stepping Slope Line (continued)
division = Division(A=level_difference_2, B=supposed_riser_value_ceiling_rounded)
round = Round(Number=division)  # -> Nearest, Floor, Ceiling
count_of_steps = Integer(round.Ceiling)
division_2 = Division(A=level_difference_2, B=count_of_steps)
resulted_riser_value = Number(division_2)
divide_curve = DivideCurve(Curve=slope_line, Count=count_of_steps, Kinks=False)  # -> Points, Tangents, Parameters
reverse_list = ReverseList(List=divide_curve.Points)
split_list = SplitList(List=reverse_list, Index=_1)  # -> ListA, ListB
riser_line_start_point_reversed = Point(split_list.ListB)
slope_line_end_point_2 = Point(split_list.ListA)
split_list_2 = SplitList(List=divide_curve.Points, Index=_1_2)  # -> ListA, ListB
reverse_list_2 = ReverseList(List=riser_line_start_point_reversed)
slope_line_start_point_2 = Point(split_list_2.ListA)
tread_line_end_point = Point(split_list_2.ListB)
riser_line_start_point = Point(reverse_list_2)
line_sdl = LineSDL(Start=riser_line_start_point, Direction=unit_z, Length=resulted_riser_value)
riser_line = Line(line_sdl)
end_points = EndPoints(Curve=riser_line)  # -> Start, End
nose_point = Point(end_points.End)
line_2 = Line(StartPoint=nose_point, EndPoint=tread_line_end_point)
tread_line = Line(line_2)
merge = Merge(Data1=riser_line, Data2=tread_line)
join_curves = JoinCurves(Curves=merge, Preserve=False)
stepped_line = Curve(join_curves)

# ---- group: Create Stair
upper_lower_landing_extend = Number(landing_extend)
stair_width_2 = Number(stair_width)
stair_depth_2 = Number(stair_depth)
line_sdl_2 = LineSDL(Start=slope_line_end_point, Direction=deconstruct_plane.XAxis, Length=upper_lower_landing_extend)
line_sdl_3 = LineSDL(Start=slope_line_start_point, Direction=expr("-x", deconstruct_plane.XAxis), Length=upper_lower_landing_extend)
end_landing_line = Line(line_sdl_2)
start_landing_line = Line(line_sdl_3)
merge_2 = Merge(Data1=start_landing_line, Data2=slope_line, Data3=end_landing_line)
join_curves_2 = JoinCurves(Curves=merge_2, Preserve=False)
offset_curve = OffsetCurve(Curve=join_curves_2, Distance=stair_depth_2, Plane=host_vertical_plane, Corners=1)
merge_3 = Merge(Data1=start_landing_line, Data2=stepped_line, Data3=end_landing_line)
end_points_2 = EndPoints(Curve=join_curves_2)  # -> Start, End
end_points_3 = EndPoints(Curve=offset_curve)  # -> Start, End
join_curves_3 = JoinCurves(Curves=merge_3, Preserve=False)
line_3 = Line(StartPoint=end_points_2.Start, EndPoint=end_points_3.Start)
line_4 = Line(StartPoint=end_points_2.End, EndPoint=end_points_3.End)
merge_4 = Merge(Data1=join_curves_3, Data2=line_4, Data3=offset_curve, Data4=line_3)
join_curves_4 = JoinCurves(Curves=merge_4, Preserve=False)
stair_profile = Curve(join_curves_4)
amplitude = Amplitude(Vector=deconstruct_plane.ZAxis, Amplitude=expr("0.5*x", stair_width_2))
amplitude_2 = Amplitude(Vector=deconstruct_plane.ZAxis, Amplitude=expr("-0.5*x", stair_width_2))
boundary_surfaces = BoundarySurfaces(Edges=flatten(stair_profile))
extrude = Extrude(Base=boundary_surfaces, Direction=[amplitude, amplitude_2])
solid_union = SolidUnion(Breps=extrude)
stair = Brep(solid_union)

# ----
riser_value_2 = ClusterOutput(resulted_riser_value)  # Resulted riser value

# ---- group: Create Deck
deck_extend_2 = Number(deck_extend)
deck_profile_fillet_radius = Number(profile_fillet)
deck_width_2 = Number(deck_width)
extend_curve = ExtendCurve(Curve=join_curves_2, Type=0, Start=deck_extend_2, End=deck_extend_2)
deck_height_2 = Number(deck_height)
offset_curve_2 = OffsetCurve(Curve=extend_curve, Distance=expr("-x", deck_height_2), Plane=host_vertical_plane, Corners=1)
offset_curve_3 = OffsetCurve(Curve=extend_curve, Distance=stair_depth_2, Plane=host_vertical_plane, Corners=1)
fillet = Fillet(Curve=offset_curve_2, Radius=deck_profile_fillet_radius)
end_points_4 = EndPoints(Curve=fillet)  # -> Start, End
end_points_5 = EndPoints(Curve=offset_curve_3)  # -> Start, End
line_5 = Line(StartPoint=end_points_4.End, EndPoint=end_points_5.End)
line_6 = Line(StartPoint=end_points_4.Start, EndPoint=end_points_5.Start)
merge_5 = Merge(Data1=fillet, Data2=line_5, Data3=offset_curve_3, Data4=line_6)
join_curves_5 = JoinCurves(Curves=merge_5, Preserve=False)
deck_profile = Curve(join_curves_5)
boundary_surfaces_2 = BoundarySurfaces(Edges=flatten(deck_profile))
amplitude_3 = Amplitude(Vector=deconstruct_plane.ZAxis, Amplitude=deck_width_2)
amplitude_4 = Amplitude(Vector=deconstruct_plane.ZAxis, Amplitude=expr("-x", deck_width_2))
extrude_2 = Extrude(Base=boundary_surfaces_2, Direction=[amplitude_3, amplitude_4])
amplitude_5 = Amplitude(Vector=deconstruct_plane.ZAxis, Amplitude=expr("0.5*x", stair_width_2))
amplitude_6 = Amplitude(Vector=deconstruct_plane.ZAxis, Amplitude=expr("-0.5*x", stair_width_2))
move = Move(Geometry=extrude_2, Motion=[amplitude_5, amplitude_6])  # -> Geometry, Transform

# ---- group: Create Glass Baluster
handrail_height_2 = Number(handrail_height)
subtraction = Subtraction(A=handrail_height_2, B=deck_height_2)
glass_baluster_height = Number(subtraction)
distance = Distance(0.1)
offset_curve_4 = OffsetCurve(Curve=fillet, Distance=expr("-x", glass_baluster_height), Plane=host_vertical_plane, Corners=1)
offset_curve_5 = OffsetCurve(Curve=fillet, Distance=distance, Plane=host_vertical_plane, Corners=1)
start = Start(0.3)
start_2 = Start(0.3)
extend_curve_2 = ExtendCurve(Curve=offset_curve_5, Type=0, Start=start, End=start)
extend_curve_3 = ExtendCurve(Curve=offset_curve_4, Type=0, Start=start_2, End=start_2)
end_points_6 = EndPoints(Curve=extend_curve_3)  # -> Start, End
end_points_7 = EndPoints(Curve=extend_curve_2)  # -> Start, End
arc_sed = ArcSED(Start=end_points_6.Start, End=end_points_7.Start, Direction=expr("-x", deconstruct_plane.XAxis))  # -> Arc, Plane, Radius
arc_sed_2 = ArcSED(Start=end_points_6.End, End=end_points_7.End, Direction=deconstruct_plane.XAxis)  # -> Arc, Plane, Radius
merge_6 = Merge(Data1=extend_curve_3, Data2=arc_sed_2.Arc, Data3=extend_curve_2, Data4=arc_sed.Arc)
join_curves_6 = JoinCurves(Curves=merge_6, Preserve=False)
number = Number(expr("0.5*x", stair_width_2))
number_2 = Number(expr("0.5*x", deck_width_2))
addition = Addition(A=number, B=number_2)
amplitude_7 = Amplitude(Vector=deconstruct_plane.ZAxis, Amplitude=expr("-x", addition))
amplitude_8 = Amplitude(Vector=deconstruct_plane.ZAxis, Amplitude=addition)
move_2 = Move(Geometry=join_curves_6, Motion=[amplitude_8, amplitude_7])  # -> Geometry, Transform
boundary_surfaces_3 = BoundarySurfaces(Edges=flatten(move_2.Geometry))
factor = Factor(0.01)
amplitude_9 = Amplitude(Vector=deconstruct_plane.ZAxis, Amplitude=factor)
amplitude_10 = Amplitude(Vector=deconstruct_plane.ZAxis, Amplitude=expr("-x", factor))
cross_reference = CrossReference(ListListA=boundary_surfaces_3, ListListB=[amplitude_9, amplitude_10], CrossMode=1)  # -> ListListA, ListListB
extrude_3 = Extrude(Base=cross_reference.ListListA, Direction=cross_reference.ListListB)
solid_union_2 = SolidUnion(Breps=extrude_3)
glass_baluster = Brep(solid_union_2)

# ---- group: Create Belt
belt_profile = Curve(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)
construct_point = ConstructPoint(XCoordinate=0, YCoordinate=0, ZCoordinate=0)
rotate_2 = Rotate(Geometry=belt_profile, Angle=radians_2, Plane=PlaneXY(0, 0, 0))  # -> Geometry, Transform
unit_z_3 = UnitZ(Factor=1)
origin_point = Point(construct_point)
_1_3 = Number(1)
sweep1_closed = Sweep1Closed(rail=move_2.Geometry, section=rotate_2.Geometry, point_a=origin_point, tangent_a=unit_z_3, miter=_1_3)
solid_union_3 = SolidUnion(Breps=sweep1_closed)
belt = Brep(solid_union_3)

# ---- group: Create Deck (continued)
merge_7 = Merge(Data1=glass_baluster, Data2=belt)
trim_solid = TrimSolid(Shape=move.Geometry, Cutters=merge_7)
deck = Brep(trim_solid)

# ---- group: Create Upper/Lower Room
upper_lower_room_extend = Number(room_extend)
amplitude_11 = Amplitude(Vector=deconstruct_plane.XAxis, Amplitude=expr("-x", upper_lower_room_extend))
amplitude_12 = Amplitude(Vector=deconstruct_plane.XAxis, Amplitude=upper_lower_room_extend)
merge_8 = Merge(Data1=amplitude_11, Data2=amplitude_12)
merge_9 = Merge(Data1=line_3, Data2=line_4)
number_3 = Number(expr("0.5*x", stair_width_2))
extrude_4 = Extrude(Base=merge_9, Direction=merge_8)
addition_2 = Addition(A=number_3, B=deck_width_2)
amplitude_13 = Amplitude(Vector=deconstruct_plane.ZAxis, Amplitude=expr("-x", addition_2))
amplitude_14 = Amplitude(Vector=deconstruct_plane.ZAxis, Amplitude=addition_2)
merge_10 = Merge(Data1=amplitude_13, Data2=amplitude_14)
extrude_5 = Extrude(Base=graft(extrude_4), Direction=merge_10)
solid_union_4 = SolidUnion(Breps=extrude_5)
solid_difference = SolidDifference(BrepsA=solid_union_4, BrepsB=flatten(deck))
upper_lower_room = Brep(solid_difference)

# ---- group: Create Escalator
merge_11 = Merge(Data1=stair, Data2=upper_lower_room, Data3=deck, Data4=glass_baluster, Data5=belt)  # -> flatten(Result)
group = Group(Objects=merge_11)
escalator = Group(group)

# ----
escalator_2 = ClusterOutput(escalator)  # Group of the Escalator elements

# ==== cluster Sweep1Closed
tangent_a = ClusterInput()  # Reference tangent
section = ClusterInput()  # Section curve
point_a = ClusterInput()  # Reference point
rail = ClusterInput()  # Rail of closed joined curves
miter = ClusterInput()  # Kink miter type (0=None, 1=Trim, 2=Rotate)
rail_of_closed_joined_curves = Curve(rail)
explode = Explode(Curve=rail_of_closed_joined_curves, Recursive=False)  # -> reparameterize(Segments), Vertices
reverse_list = ReverseList(List=explode.Vertices)
split_list = SplitList(List=reverse_list, Index=1)  # -> ListA, ListB
reverse_list_2 = ReverseList(List=split_list.ListB)
curve_closest_point = CurveClosestPoint(Point=reverse_list_2, Curve=explode.Segments)  # -> Point, Parameter, Distance
evaluate_curve = EvaluateCurve(Curve=explode.Segments, Parameter=curve_closest_point.Parameter)  # -> Point, Tangent, Angle
reference_tangent = Vector(tangent_a)
reference_point = Point(point_a)
section_curve = Curve(section)
orient_direction = OrientDirection(
    Geometry=section_curve,
    PointA=reference_point,
    DirectionA=reference_tangent,
    PointB=reverse_list_2,
    DirectionB=evaluate_curve.Tangent)  # -> Geometry, Transform
kink_miter_type_0_none_1_trim_2_rotate = Integer(miter)
sweep1 = Sweep1(Rail=graft(explode.Segments), Sections=graft(orient_direction.Geometry), Miter=kink_miter_type_0_none_1_trim_2_rotate)  # -> flatten(Brep)
brep_join = BrepJoin(Breps=sweep1)  # -> Breps, Closed
resulting_brep = Brep(brep_join.Breps)
brep = ClusterOutput(resulting_brep)  # Resulting brep
