# Grasshopper definition joinmullions.gh (Grasshopper 1.0.7)
# plug-ins: Pufferfish, HAL for Grasshopper

sessionsettings = SessionSettings()
brep = Brep([<brep referenced from the Rhino model> x501])
mesh = Mesh(brep)
brep_2 = Brep([<brep referenced from the Rhino model> x861])
cap = CapHoles(Brep=brep_2)
offmsh = OffsetMesh(Mesh=mesh, Distance="-10", BothSides=False, CreateSolid=True)  # -> flatten(Offset)
mesh_2 = Mesh(cap)
mjoin = MeshJoin(Meshes=[offmsh, mesh_2])
mesh_3 = Mesh(mjoin)
